# Dynamo graph 120-Dome-KIT.dyn (Dynamo 2.17.0.3472)
# packages: Structural Analysis for Dynamo 2.17.0

code_block = CodeBlock()
# ---------- code_block.designscript (4 lines) ----------
point0 = Point.ByCoordinates(0, 0, 7);
point1 = Point.ByCoordinates(0, 0, 5);
point2 = Point.ByCoordinates(0, 0, 3);
point3 = Point.ByCoordinates(0, 0, 0);
# ----------------------------------------
list_create = List.Create(item0=code_block.point0, item1=code_block.point1, item2=code_block.point2, item3=code_block.point3)

# group: Geometry config
code_block_2 = CodeBlock { [0.2,6.941,12.5,15.89]; }
byCenterPointRadius = Circle.ByCenterPointRadius(centerPoint=list_create, radius=code_block_2)
code_block_3 = CodeBlock { 12; }
regularPolygon = Polygon.RegularPolygon(circle=byCenterPointRadius, numberSides=code_block_3)
explode = Geometry.Explode(geometry=regularPolygon)
pointAtParameter = Curve.PointAtParameter(curve=explode)

# group: Group 0
code_block_4 = CodeBlock(lst=explode) { lst[0]; }

# group: Group 1
code_block_5 = CodeBlock(lst=pointAtParameter) { lst[0]; }
code_block_6 = CodeBlock(lst=pointAtParameter) { lst[1]; }
byStartPointEndPoint = Line.ByStartPointEndPoint(startPoint=code_block_5, endPoint=code_block_6)

# group: Group 2
code_block_7 = CodeBlock(lst=explode) { lst[1]; }

# group: Group 3
code_block_8 = CodeBlock(lst=pointAtParameter) { lst[1]; lst[2]; }
byStartPointEndPoint_2 = Line.ByStartPointEndPoint(startPoint=code_block_8.out0, endPoint=code_block_8.out1)

# group: Group 4
code_block_9 = CodeBlock(lst=pointAtParameter) { lst[1]; }
firstItem = List.FirstItem(list=code_block_9)
list_create_2 = List.Create()  # unwired: item0, item1
code_block_10 = CodeBlock(lst=explode) { lst[2]; }
code_block_11 = CodeBlock { 0.5; }
pointAtParameter_2 = Curve.PointAtParameter(curve=code_block_10, param=code_block_11)
combine = List.Combine(combineFunction=list_create_2, list0=code_block_9, list1=pointAtParameter_2)
addItemToEnd = List.AddItemToEnd(item=firstItem, list=combine)
flatten = List.Flatten(list=addItemToEnd)
byPoints = PolyCurve.ByPoints(points=flatten)
explode_2 = Geometry.Explode(geometry=byPoints)

# group: Group 7
code_block_12 = CodeBlock { 0.5; }
code_block_13 = CodeBlock(lst=pointAtParameter) { lst[3]; }
firstItem_2 = List.FirstItem(list=code_block_13)
list_create_3 = List.Create()  # unwired: item0, item1
pointAtParameter_3 = Curve.PointAtParameter(curve=code_block_10, param=code_block_12)
combine_2 = List.Combine(combineFunction=list_create_3, list0=code_block_13, list1=pointAtParameter_3)
addItemToEnd_2 = List.AddItemToEnd(item=firstItem_2, list=combine_2)
flatten_2 = List.Flatten(list=addItemToEnd_2)
byPoints_2 = PolyCurve.ByPoints(points=flatten_2)
explode_3 = Geometry.Explode(geometry=byPoints_2)

# group: Group 5
code_block_14 = CodeBlock(lst=pointAtParameter) { lst[2]; }
firstItem_3 = List.FirstItem(list=code_block_14)
list_create_4 = List.Create()  # unwired: item0, item1
pointAtParameter_4 = Curve.PointAtParameter(curve=code_block_10, param=code_block_12)
combine_3 = List.Combine(combineFunction=list_create_4, list0=code_block_14, list1=pointAtParameter_4)
addItemToEnd_3 = List.AddItemToEnd(item=firstItem_3, list=combine_3)
flatten_3 = List.Flatten(list=addItemToEnd_3)
byPoints_3 = PolyCurve.ByPoints(points=flatten_3)
explode_4 = Geometry.Explode(geometry=byPoints_3)

# group: Group 6
code_block_15 = CodeBlock(lst=pointAtParameter) { lst[2]; lst[3]; }
byStartPointEndPoint_3 = Line.ByStartPointEndPoint(startPoint=code_block_15.out0, endPoint=code_block_15.out1)

list_create_5 = List.Create(item0=code_block_4, item1=byStartPointEndPoint, item2=code_block_7, item3=byStartPointEndPoint_2, item4=explode_2, item5=explode_4, item6=byStartPointEndPoint_3, item7=explode_3)
flatten_4 = List.Flatten(list=list_create_5)  # frozen
code_block_16 = CodeBlock { [10,19,13,8,12,11,3,9]; }
code_block_17 = CodeBlock(br_index=code_block_16) { br_index: var[]..[]; }

# group: Sections
sections = CodeBlock()
# ---------- sections.designscript (26 lines) ----------
["RB .625",
"RB .75",
"RB .875",
"RB 1",
"RB 1.125",
"RB 1.25",
"RB 1.375",
"RB 1.5",
"RB 1.625",
"RB 1.75",
"RB 1.875",
"RB 2",
"RB 2.125",
"RB 2.25",
"RB 2.375",
"RB 2.5",
"RB 2.625",
"RB 2.75",
"RB 2.875",
"RB 3",
"RB 3.125",
"RB 3.25",
"RB 3.375",
"RB 3.5",
"RB 3.625"
];
# ----------------------------------------
loadSections = DynamoSimulation.RSA.AnalyticalModel.Attributes.Bars.LoadSections(sectionsToLoad=sections)
code_block_18 = CodeBlock(lst=code_block_17) { lst[0]; lst[1]; lst[2]; lst[3]; lst[4]; lst[5]; lst[6]; lst[7]; }
code_block_19 = CodeBlock(t2=code_block_18.out0, t4=code_block_18.out1, t6=code_block_18.out2, t8=code_block_18.out3, t10=code_block_18.out4, t12=code_block_18.out5, t14=code_block_18.out6, t16=code_block_18.out7)
# ---------- code_block_19.designscript (9 lines) ----------
t1 = List.OfRepeatedItem(t2, 12);
t3 = List.OfRepeatedItem(t4, 12);
t5 = List.OfRepeatedItem(t6, 12);
t7 = List.OfRepeatedItem(t8, 24);
t9 = List.OfRepeatedItem(t10, 24);
t11 = List.OfRepeatedItem(t12, 12);
t13 = List.OfRepeatedItem(t14, 24);
t15 = List.OfRepeatedItem(t16, 12);
t17 = [t1, t3, t5, t7, t9, t11, t13,t15];
# ----------------------------------------
flatten_5 = List.Flatten(list=code_block_19.t17)
getItemAtIndex = List.GetItemAtIndex(list=loadSections, index=flatten_5)

# group: Bars and Section assignment
byLines = DynamoSimulation.RSA.AnalyticalModel.AnalyticalBar.ByLines(lines=flatten_4)
setSectionByName = DynamoSimulation.RSA.AnalyticalModel.AnalyticalBar.SetSectionByName(analyticalBars=byLines@L1, name=getItemAtIndex@L1)
code_block_20 = CodeBlock { "Steel"; }
setMaterialByName = DynamoSimulation.RSA.AnalyticalModel.AnalyticalBar.SetMaterialByName(analyticalBars=setSectionByName, name=code_block_20)
flatten_6 = List.Flatten(list=setMaterialByName)

# group: Supports
byPoint = DynamoSimulation.RSA.AnalyticalModel.AnalyticalNode.ByPoint(point=code_block_15.out1)
code_block_21 = CodeBlock { "Pinned"; }
setSupportByName = DynamoSimulation.RSA.AnalyticalModel.AnalyticalNode.SetSupportByName(nodes=byPoint, name=code_block_21)

# group: Loads
code_block_22 = CodeBlock { "Dead"; }
code_block_23 = CodeBlock { "Selfweight"; }
byNature = DynamoSimulation.RSA.AnalyticalModel.Loads.LoadCase.ByNature(caseNature=code_block_22, caseName=code_block_23)
createSelfWeightLoad = DynamoSimulation.RSA.AnalyticalModel.Loads.SelfWeightLoad.CreateSelfWeightLoad(loadCase=byNature)
loadCase = DynamoSimulation.RSA.AnalyticalModel.Loads.SelfWeightLoad.LoadCase(selfWeightLoad=createSelfWeightLoad)
byPoint_2 = DynamoSimulation.RSA.AnalyticalModel.AnalyticalNode.ByPoint()  # unwired: point
code_block_24 = CodeBlock { "Dead"; }
code_block_25 = CodeBlock { "FZ1"; }
byNature_2 = DynamoSimulation.RSA.AnalyticalModel.Loads.LoadCase.ByNature(caseNature=code_block_24, caseName=code_block_25)
count = List.Count()  # unwired: list
code_block_26 = CodeBlock(n=count)
# ---------- code_block_26.designscript (2 lines) ----------
//Load in N
-60000/n;
# ----------------------------------------
byNodes = DynamoSimulation.RSA.AnalyticalModel.Loads.NodalLoad.ByNodes(analyticalNodes=byPoint_2, loadCase=byNature_2, fz=code_block_26)
code_block_27 = CodeBlock(lst=pointAtParameter) { lst[0]; lst[1]; }
byPoint_3 = DynamoSimulation.RSA.AnalyticalModel.AnalyticalNode.ByPoint(point=code_block_27.out0)
code_block_28 = CodeBlock()
# ---------- code_block_28.designscript (2 lines) ----------
//Load in N
-30000;
# ----------------------------------------
byNodes_2 = DynamoSimulation.RSA.AnalyticalModel.Loads.NodalLoad.ByNodes(analyticalNodes=byPoint_3, loadCase=byNature_2, fz=code_block_28)
byPoint_4 = DynamoSimulation.RSA.AnalyticalModel.AnalyticalNode.ByPoint(point=code_block_27.out1)
code_block_29 = CodeBlock()
# ---------- code_block_29.designscript (2 lines) ----------
//Load in N
-10000;
# ----------------------------------------
byNodes_3 = DynamoSimulation.RSA.AnalyticalModel.Loads.NodalLoad.ByNodes(analyticalNodes=byPoint_4, loadCase=byNature_2, fz=code_block_29)
list_create_6 = List.Create(item0=loadCase, item1=byNodes, item2=byNodes_2, item3=byNodes_3, item4=byNature_2)

# group: Analysis in RSA
list_create_7 = List.Create(item0=flatten_6, item1=setSupportByName, item2=list_create_6)
code_block_30 = CodeBlock { "ManualConfig"; }
directory_path = Directory("C:\Users\MONSTER\OneDrive\Masaüstü\TEZ\Examples")
calculateWithSave = DynamoSimulation.RSA.Analysis.CalculateWithSave(elements=list_create_7, parameters=code_block_30, directoryPath=directory_path)

# group: Extract Deformation
code_block_31 = CodeBlock(lst=calculateWithSave.loadCases) { lst[1]; }
id = DynamoSimulation.RSA.AnalyticalModel.Loads.LoadCase.Id(loadCase=code_block_31)
code_block_32 = CodeBlock { 0; }
getValuesAt = DynamoSimulation.RSA.RSAResults.Bar.BarDisplacements.GetValuesAt(analyticalBar=calculateWithSave.analyticalBars, loadCaseId=id, position=code_block_32)
code_block_33 = CodeBlock(d=getValuesAt.UZ)
# ---------- code_block_33.designscript (2 lines) ----------
//Convert to mm
Math.Round(d*1000,2);
# ----------------------------------------
abs = Math.Abs(number=code_block_33)
code_block_34 = CodeBlock(lst=abs) { lst[0]; lst[24..35]; lst[60..83]; lst[84..95]; }
code_block_35 = CodeBlock { 0..22..2; }
getItemAtIndex_2 = List.GetItemAtIndex(list=code_block_34.out2, index=code_block_35)
code_block_36 = CodeBlock { 1..23..2; }
getItemAtIndex_3 = List.GetItemAtIndex(list=code_block_34.out2, index=code_block_36)
list_create_8 = List.Create(item0=code_block_34.out0, item1=code_block_34.out1, item2=getItemAtIndex_2, item3=getItemAtIndex_3)

# group: Extract Stresses
code_block_37 = CodeBlock { "FXSX"; }
getMaxValuesList = DynamoSimulation.RSA.RSAResults.Bar.BarStresses.GetMaxValuesList(name=code_block_37, analyticalBars=calculateWithSave.analyticalBars, loadCasesIds=id)
code_block_38 = CodeBlock { 0; }

sum = Math.Sum(values=getMaxValuesList@L2)

# group (continued): Extract Stresses
flatten_7 = List.Flatten(list=sum)
gt = flatten_7 > code_block_38
filterByBoolMask = List.FilterByBoolMask(list=flatten_7, mask=gt)
list_create_9 = List.Create(item0=filterByBoolMask.in)
code_block_39 = CodeBlock(S=list_create_9)
# ---------- code_block_39.designscript (2 lines) ----------
//Convert to N/mm²
Math.Round(S/1000000,2);
# ----------------------------------------
flatten_8 = List.Flatten(list=code_block_39)
list_create_10 = List.Create(item0=filterByBoolMask.out)
abs_2 = Math.Abs(number=list_create_10)
code_block_40 = CodeBlock(S=abs_2)  # same code as code_block_39
flatten_9 = List.Flatten(list=code_block_40)

# group: Extract Selfweight
id_2 = DynamoSimulation.RSA.AnalyticalModel.Loads.LoadCase.Id(loadCase=loadCase)
getValues = DynamoSimulation.RSA.RSAResults.Node.NodeReactions.GetValues(analyticalNode=calculateWithSave.analyticalNodes, loadCaseId=id_2)
sum_2 = Math.Sum(values=getValues.FZ)
code_block_41 = CodeBlock(w=sum_2) { Math.Round(w/9.81); }

# group: Evaluate Stresses
code_block_42 = CodeBlock { TensAllowableStress=172.37; CompAllowableStress=175.37; AllowableDisplacement_mm=50.8; ViolationCoefficient=10; }
stress_score_evaluation = Python(IN[0]=flatten_8, IN[1]=flatten_9, IN[2]=list_create_8, IN[3]=code_block_41, IN[4]=code_block_42.TensAllowableStress, IN[5]=code_block_42.CompAllowableStress, IN[6]=code_block_42.AllowableDisplacement_mm, IN[7]=code_block_42.ViolationCoefficient)  # CPython3
# ---------- stress_score_evaluation.python (42 lines) ----------
import clr
clr.AddReference('ProtoGeometry')
from Autodesk.DesignScript.Geometry import *
#The inputs to this node will be stored as a list in the IN variables.
dataEnteringNode = IN

#Actual stress in the bar
Tensstress=IN[0]
Compstress=IN[1]
Displacement=IN[2]
#Set the maximal allowable stress
weight=IN[3]
#Sets the scoring system for the stress ratios
TensAllowableStress=IN[4]
CompAllowableStress=IN[5]
AllowableDisplacement=IN[6]

violation_coef=IN[7]

stress_ratio=[]
violation = 0  # Initialize violation as a float or integer

for i in Tensstress:
    ratio = i / TensAllowableStress
    stress_ratio.append(ratio)

for i in Compstress:
    ratio = i / CompAllowableStress
    stress_ratio.append(ratio)
     
for d in Displacement:
    ratio = d / AllowableDisplacement
    stress_ratio.append(ratio)

for r in stress_ratio:
    if r - 1 > 0:
        violation += r - 1

weight_score=weight*(1+(violation*violation_coef))

#Assign your output to the OUT variable.
OUT = weight_score
# ----------------------------------------

code_block_43 = CodeBlock(WS=stress_score_evaluation) { WS; }

# group: Bar End Releases
code_block_44 = CodeBlock { "Pinned-Pinned"; }
setReleaseByName = DynamoSimulation.RSA.AnalyticalModel.AnalyticalBar.SetReleaseByName(analyticalBars=setMaterialByName, name=code_block_44)
