# Dynamo graph 2D 10 bar Truss.dyn (Dynamo 2.17.0.3472)
# packages: Structural Analysis for Dynamo 2.17.0

# group: INPUTS
lenght = DoubleSlider(15, range=1..20 step 1)
num_of_vertical_struts = DoubleSlider(2, range=1..20 step 1)
height = DoubleSlider(12, range=1..20 step 1)
top_beams_section = DoubleSlider(5, range=1..20 step 1)
bottom_beams_section = DoubleSlider(5, range=1..20 step 1)
colums_section = DoubleSlider(12, range=1..20 step 1)
bracings_section = DoubleSlider(10, range=1..20 step 1)

# group: GEOMETRY
code_block = CodeBlock(L=lenght, PanelNum=num_of_vertical_struts) { 0..L..#PanelNum+1; }  # frozen
starting_points_truss = CodeBlock(x1=code_block, H=height, x2=code_block) { p1=Point.ByCoordinates(x1,0,H); p2=Point.ByCoordinates(x2,0,0); }
byCoordinates = Point.ByCoordinates()

# group: GEOMETRY > Top Beams
byPoints = PolyCurve.ByPoints(points=starting_points_truss.p1)
curves = PolyCurve.Curves(polyCurve=byPoints)

# group: GEOMETRY > Bottom Beams
byPoints_2 = PolyCurve.ByPoints(points=starting_points_truss.p2)
curves_2 = PolyCurve.Curves(polyCurve=byPoints_2)

# group: GEOMETRY > Columns
byStartPointEndPoint = Line.ByStartPointEndPoint(startPoint=starting_points_truss.p1, endPoint=starting_points_truss.p2)

# group: GEOMETRY > Bracings
code_block_2 = CodeBlock(PointsListCurve1=starting_points_truss.p1) { PointsListCurve1: var[]..[]; }
code_block_3 = CodeBlock { 1; -1; }
dropItems = List.DropItems(list=code_block_2, amount=code_block_3.out0)
code_block_4 = CodeBlock(PointsListCurve2=starting_points_truss.p2) { PointsListCurve2: var[]..[]; }
dropItems_2 = List.DropItems(list=code_block_4, amount=code_block_3.out1)
byStartPointEndPoint_2 = Line.ByStartPointEndPoint(startPoint=dropItems, endPoint=dropItems_2)
code_block_5 = CodeBlock { -1; 1; }
dropItems_3 = List.DropItems(list=code_block_2, amount=code_block_5.out0)
dropItems_4 = List.DropItems(list=code_block_4, amount=code_block_5.out1)
byStartPointEndPoint_3 = Line.ByStartPointEndPoint(startPoint=dropItems_3, endPoint=dropItems_4)
list_create = List.Create(item0=byStartPointEndPoint_2, item1=byStartPointEndPoint_3)
flatten = List.Flatten(list=list_create)

# group (continued): GEOMETRY
list_create_2 = List.Create(item0=curves, item1=curves_2, item2=byStartPointEndPoint, item3=flatten)
flatten_2 = List.Flatten(list=list_create_2)

# group: RSA > Sections
code_block_6 = CodeBlock()
# ---------- code_block_6.designscript (18 lines) ----------
//Section List
["IPE 100",
"IPE 120",
"IPE 140",
"IPE 160",
"IPE 180",
"IPE 200",
"IPE 220",
"IPE 240",
"IPE 270",
"IPE 300",
"IPE 330",
"IPE 360",
"IPE 400",
"IPE 450",
"IPE 500",
"IPE 550",
"IPE 600"];
# ----------------------------------------
loadSections = DynamoSimulation.RSA.AnalyticalModel.Attributes.Bars.LoadSections(sectionsToLoad=code_block_6)
inputs = List.Create(item0=top_beams_section, item1=bottom_beams_section, item2=colums_section, item3=bracings_section)
count = List.Count(list=list_create_2@L2)
ofRepeatedItem = List.OfRepeatedItem(item=inputs@L1, amount=count@L1)
getItemAtIndex = List.GetItemAtIndex(list=loadSections, index=ofRepeatedItem)
flatten_3 = List.Flatten(list=getItemAtIndex)

# group: RSA > Analytical Bars
byLines = DynamoSimulation.RSA.AnalyticalModel.AnalyticalBar.ByLines(lines=flatten_2)
setSectionByName = DynamoSimulation.RSA.AnalyticalModel.AnalyticalBar.SetSectionByName(analyticalBars=byLines@L1, name=flatten_3@L1)
code_block_7 = CodeBlock { "S 235"; }
setMaterialByName = DynamoSimulation.RSA.AnalyticalModel.AnalyticalBar.SetMaterialByName(analyticalBars=setSectionByName, name=code_block_7)

# group: RSA > Supports
firstItem = List.FirstItem(list=starting_points_truss.p1)
firstItem_2 = List.FirstItem(list=starting_points_truss.p2)
list_create_3 = List.Create(item0=firstItem, item1=firstItem_2)
byPoint = DynamoSimulation.RSA.AnalyticalModel.AnalyticalNode.ByPoint(point=list_create_3@L2)
code_block_8 = CodeBlock { "Pinned"; "Fixed"; }
list_create_4 = List.Create(item0=code_block_8.out0, item1=code_block_8.out1)
setSupportByName = DynamoSimulation.RSA.AnalyticalModel.AnalyticalNode.SetSupportByName(nodes=byPoint@L1, name=list_create_4@L1)

# group: RSA > Loads
code_block_9 = CodeBlock { "Dead"; }  # frozen
code_block_10 = CodeBlock { "Selfweight"; }
byNature = DynamoSimulation.RSA.AnalyticalModel.Loads.LoadCase.ByNature(caseNature=code_block_9, caseName=code_block_10)
createSelfWeightLoad = DynamoSimulation.RSA.AnalyticalModel.Loads.SelfWeightLoad.CreateSelfWeightLoad(loadCase=byNature)
loadCase = DynamoSimulation.RSA.AnalyticalModel.Loads.SelfWeightLoad.LoadCase(selfWeightLoad=createSelfWeightLoad)
code_block_11 = CodeBlock { "Dead"; }
code_block_12 = CodeBlock { "FZ1"; }
byNature_2 = DynamoSimulation.RSA.AnalyticalModel.Loads.LoadCase.ByNature(caseNature=code_block_11, caseName=code_block_12)
lastItem = List.LastItem(list=starting_points_truss.p1)
byPoint_2 = DynamoSimulation.RSA.AnalyticalModel.AnalyticalNode.ByPoint(point=lastItem)
code_block_13 = CodeBlock()
# ---------- code_block_13.designscript (2 lines) ----------
//Load in N
444822.16;
# ----------------------------------------
byNodes = DynamoSimulation.RSA.AnalyticalModel.Loads.NodalLoad.ByNodes(analyticalNodes=byPoint_2, loadCase=byNature_2, fz=code_block_13)
list_create_5 = List.Create(item0=loadCase, item1=byNature_2, item2=byNodes)

# group: Analysis in RSA
list_create_6 = List.Create(item0=setMaterialByName, item1=setSupportByName, item2=list_create_5)
flatten_4 = List.Flatten(list=list_create_6)
code_block_14 = CodeBlock { "ManualConfig"; }
directory_path = Directory("C:\Users\ugury\OneDrive\Masaüstü\Dynamo Lecture\Examples")
calculateWithSave = DynamoSimulation.RSA.Analysis.CalculateWithSave(elements=flatten_4, parameters=code_block_14, directoryPath=directory_path)

# group: RESULTS > Extract Stresses
code_block_15 = CodeBlock { "FXSX"; }
id = DynamoSimulation.RSA.AnalyticalModel.Loads.LoadCase.Id(loadCase=byNature_2)
getMaxValuesList = DynamoSimulation.RSA.RSAResults.Bar.BarStresses.GetMaxValuesList(name=code_block_15, analyticalBars=calculateWithSave.analyticalBars, loadCasesIds=id)
sum = Math.Sum(values=getMaxValuesList@L2)
code_block_16 = CodeBlock(S=sum)
# ---------- code_block_16.designscript (2 lines) ----------
//Convert to N/mm²
Math.Round(S/1000000,2);
# ----------------------------------------
flatten_5 = List.Flatten(list=code_block_16)

# group: RESULTS > Extract Deformation
code_block_17 = CodeBlock(lst=count) { lst[0]; }
code_block_18 = CodeBlock(x=code_block_17) { 0..2*x-1; }
getItemAtIndex_2 = List.GetItemAtIndex(list=calculateWithSave.analyticalBars, index=code_block_18)
code_block_19 = CodeBlock { 1; }
getValuesAt = DynamoSimulation.RSA.RSAResults.Bar.BarDisplacements.GetValuesAt(analyticalBar=getItemAtIndex_2, loadCaseId=id, position=code_block_19)
code_block_20 = CodeBlock(d=getValuesAt.UZ)
# ---------- code_block_20.designscript (2 lines) ----------
//Convert to mm
Math.Round(d*1000,2);
# ----------------------------------------
abs = Math.Abs(number=code_block_20)

# group: RESULTS > Extract Selfweight
id_2 = DynamoSimulation.RSA.AnalyticalModel.Loads.LoadCase.Id(loadCase=loadCase)
getValues = DynamoSimulation.RSA.RSAResults.Node.NodeReactions.GetValues(analyticalNode=calculateWithSave.analyticalNodes, loadCaseId=id_2)
sum_2 = Math.Sum(values=getValues.FZ)
code_block_21 = CodeBlock(w=sum_2) { Math.Round(w/9.81); }

# group: Evaluate Stresses
boundary_conditions = CodeBlock { TensAllowableStress=172.37; CompAllowableStress=172.37; AllowableDisplacement_mm=50.8; ViolationCoefficient=10; }
weight_score_evaluation = Python(IN[0]=flatten_5, IN[1]=abs, IN[2]=code_block_21, IN[3]=boundary_conditions.TensAllowableStress, IN[4]=boundary_conditions.CompAllowableStress, IN[5]=boundary_conditions.AllowableDisplacement_mm, IN[6]=boundary_conditions.ViolationCoefficient)  # CPython3
# ---------- weight_score_evaluation.python (59 lines) ----------
import clr
clr.AddReference('ProtoGeometry')
from Autodesk.DesignScript.Geometry import *
#The inputs to this node will be stored as a list in the IN variables.
dataEnteringNode = IN


#Actual stress in the bar
stress=IN[0]

Displacement=IN[1]
#Set the maximal allowable stress
weight=IN[2]
#Sets the scoring system for the stress ratios
TensAllowableStress=IN[3]
bucling=IN[4]
AllowableDisplacement=IN[5]

violation_coef=IN[6]

tensstress=[]
compstress=[]
compindex=[]
for index, value in enumerate(stress):
    if value < 0:
        compstress.append((value))
        compindex.append((index))
    else: 
        tensstress.append((value))    

compstress=[abs(value) for value in compstress]

#CompAllowableStress=[bucling[index] for index in compindex]
CompAllowableStress=bucling

stress_ratio=[]
violation = 0  # Initialize violation as a float or integer

for i in tensstress:
    ratio = i / TensAllowableStress
    stress_ratio.append(ratio)

for i in compstress:
    ratio = i / CompAllowableStress
    stress_ratio.append(ratio)


for d in Displacement:
    ratio = d / AllowableDisplacement
    stress_ratio.append(ratio)

for r in stress_ratio:
    if r - 1 > 0:
        violation += r - 1

weight_score=weight*(1+(violation*violation_coef))

#Assign your output to the OUT variable.
OUT = weight_score
# ----------------------------------------

code_block_22 = CodeBlock(WS=weight_score_evaluation) { WS; }

# group: RSA > Bar End Releases
code_block_23 = CodeBlock { "Pinned-Pinned"; }
setReleaseByName = DynamoSimulation.RSA.AnalyticalModel.AnalyticalBar.SetReleaseByName(analyticalBars=byLines, name=code_block_23)

n2d_10_bar_truss = Custom[2D 10 bar Truss]()  # unwired: SetcionIndex
code_block_24 = CodeBlock { [0,2,5,1]; }
n2d_10_bar_truss_2 = Custom[2D 10 bar Truss](SetcionIndex=code_block_24)
