# Dynamo graph 3D 36 bar Truss.dyn (Dynamo 2.17.0.3472)
# packages: Structural Analysis for Dynamo 2.17.0

# group: INPUTS
lenght = DoubleSlider(10, range=1..20 step 1)
num_of_vertical_struts = DoubleSlider(9, range=1..20 step 1)
height = DoubleSlider(4, range=1..20 step 1)
beams_section = DoubleSlider(2, range=1..20 step 1)
colums_section = DoubleSlider(12, range=1..20 step 1)
bracings_section = DoubleSlider(10, range=1..20 step 1)

width_of_truss = DoubleSlider(4, range=1..20 step 1)

# group: GEOMETRY
code_block = CodeBlock(L=lenght, Panelnum=num_of_vertical_struts) { 0..L..#Panelnum+1; }
starting_points_truss = CodeBlock(x=code_block, A=width_of_truss, H=height, B=width_of_truss) { p1=Point.ByCoordinates(x,0,0); p2=Point.ByCoordinates(x,-A,H); p3=Point.ByCoordinates(x,B,H); }

# group: GEOMETRY > Beams
list_create = List.Create(item0=starting_points_truss.p1, item1=starting_points_truss.p2, item2=starting_points_truss.p3)
byPoints = PolyCurve.ByPoints(points=list_create)
curves = PolyCurve.Curves(polyCurve=byPoints)

# group (continued): GEOMETRY
flatten = List.Flatten(list=curves)

# group: GEOMETRY > Vertical Elements
list_create_2 = List.Create()  # unwired: item0, item1, item2, item3
combine = List.Combine(combineFunction=list_create_2, list0=starting_points_truss.p1, list1=starting_points_truss.p2, list2=starting_points_truss.p3, list3=starting_points_truss.p1)
byPoints_2 = PolyCurve.ByPoints(points=combine)
curves_2 = PolyCurve.Curves(polyCurve=byPoints_2)

# group (continued): GEOMETRY
flatten_2 = List.Flatten(list=curves_2)

# group: GEOMETRY > Bracings1
code_block_2 = CodeBlock { 1; -1; }
dropItems = List.DropItems(list=starting_points_truss.p2, amount=code_block_2.out0)
dropItems_2 = List.DropItems(list=starting_points_truss.p3, amount=code_block_2.out1)
byStartPointEndPoint = Line.ByStartPointEndPoint(startPoint=dropItems@L2, endPoint=dropItems_2@L2)
code_block_3 = CodeBlock { -1; 1; }
dropItems_3 = List.DropItems(list=starting_points_truss.p2, amount=code_block_3.out0)
dropItems_4 = List.DropItems(list=starting_points_truss.p3, amount=code_block_3.out1)
byStartPointEndPoint_2 = Line.ByStartPointEndPoint(startPoint=dropItems_3, endPoint=dropItems_4)
list_create_3 = List.Create(item0=byStartPointEndPoint, item1=byStartPointEndPoint_2)
flatten_3 = List.Flatten(list=list_create_3)

# group: GEOMETRY > Bracings2
code_block_4 = CodeBlock { 1; -1; }
dropItems_5 = List.DropItems(list=starting_points_truss.p1, amount=code_block_4.out0)
dropItems_6 = List.DropItems(list=starting_points_truss.p2, amount=code_block_4.out1)
byStartPointEndPoint_3 = Line.ByStartPointEndPoint(startPoint=dropItems_5@L2, endPoint=dropItems_6@L2)
code_block_5 = CodeBlock { -1; 1; }
dropItems_7 = List.DropItems(list=starting_points_truss.p1, amount=code_block_5.out0)
dropItems_8 = List.DropItems(list=starting_points_truss.p2, amount=code_block_5.out1)
byStartPointEndPoint_4 = Line.ByStartPointEndPoint(startPoint=dropItems_7, endPoint=dropItems_8)
list_create_4 = List.Create(item0=byStartPointEndPoint_3, item1=byStartPointEndPoint_4)
flatten_4 = List.Flatten(list=list_create_4)

# group: GEOMETRY > Bracings3
code_block_6 = CodeBlock { 1; -1; }
dropItems_9 = List.DropItems(list=starting_points_truss.p1, amount=code_block_6.out0)
dropItems_10 = List.DropItems(list=starting_points_truss.p3, amount=code_block_6.out1)
byStartPointEndPoint_5 = Line.ByStartPointEndPoint(startPoint=dropItems_9@L2, endPoint=dropItems_10@L2)
code_block_7 = CodeBlock { -1; 1; }
dropItems_11 = List.DropItems(list=starting_points_truss.p1, amount=code_block_7.out0)
dropItems_12 = List.DropItems(list=starting_points_truss.p3, amount=code_block_7.out1)
byStartPointEndPoint_6 = Line.ByStartPointEndPoint(startPoint=dropItems_11, endPoint=dropItems_12)
list_create_5 = List.Create(item0=byStartPointEndPoint_5, item1=byStartPointEndPoint_6)
flatten_5 = List.Flatten(list=list_create_5)

# group (continued): GEOMETRY
list_create_6 = List.Create(item0=flatten_3, item1=flatten_4, item2=flatten_5)
flatten_6 = List.Flatten(list=list_create_6)
list_create_7 = List.Create(item0=flatten, item1=flatten_2, item2=flatten_6)
flatten_7 = List.Flatten(list=list_create_7)  # frozen

# group: RSA > Sections
code_block_8 = CodeBlock()
# ---------- code_block_8.designscript (18 lines) ----------
//Section List
["IPE 100",
"IPE 120",
"IPE 140",
"IPE 160",
"IPE 180",
"IPE 200",
"IPE 220",
"IPE 240",
"IPE 270",
"IPE 300",
"IPE 330",
"IPE 360",
"IPE 400",
"IPE 450",
"IPE 500",
"IPE 550",
"IPE 600"];
# ----------------------------------------
loadSections = DynamoSimulation.RSA.AnalyticalModel.Attributes.Bars.LoadSections(sectionsToLoad=code_block_8)
list_create_8 = List.Create(item0=beams_section, item1=colums_section, item2=bracings_section)
count = List.Count(list=list_create_7@L2)
ofRepeatedItem = List.OfRepeatedItem(item=list_create_8@L1, amount=count@L1)
getItemAtIndex = List.GetItemAtIndex(list=loadSections, index=ofRepeatedItem)
flatten_8 = List.Flatten(list=getItemAtIndex)

# group: RSA > Analytical Bars Bracings
byLines = DynamoSimulation.RSA.AnalyticalModel.AnalyticalBar.ByLines(lines=flatten_7)
setSectionByName = DynamoSimulation.RSA.AnalyticalModel.AnalyticalBar.SetSectionByName(analyticalBars=byLines@L1, name=flatten_8@L1)
code_block_9 = CodeBlock { "STEEL"; }
setMaterialByName = DynamoSimulation.RSA.AnalyticalModel.AnalyticalBar.SetMaterialByName(analyticalBars=setSectionByName, name=code_block_9)

# group: RSA > Supports
firstItem = List.FirstItem(list=starting_points_truss.p1)
firstItem_2 = List.FirstItem(list=starting_points_truss.p2)
firstItem_3 = List.FirstItem(list=starting_points_truss.p3)
list_create_9 = List.Create(item0=firstItem, item1=firstItem_2, item2=firstItem_3)
byPoint = DynamoSimulation.RSA.AnalyticalModel.AnalyticalNode.ByPoint(point=list_create_9@L2)
code_block_10 = CodeBlock { "Pinned"; "Pinned"; "Pinned"; }
list_create_10 = List.Create(item0=code_block_10.out0, item1=code_block_10.out1, item2=code_block_10.out2)
setSupportByName = DynamoSimulation.RSA.AnalyticalModel.AnalyticalNode.SetSupportByName(nodes=byPoint@L1, name=list_create_10@L1)

# group: RSA > Loads
code_block_11 = CodeBlock { "Dead"; }
code_block_12 = CodeBlock { "Selfweight"; }
byNature = DynamoSimulation.RSA.AnalyticalModel.Loads.LoadCase.ByNature(caseNature=code_block_11, caseName=code_block_12)
createSelfWeightLoad = DynamoSimulation.RSA.AnalyticalModel.Loads.SelfWeightLoad.CreateSelfWeightLoad(loadCase=byNature)
loadCase = DynamoSimulation.RSA.AnalyticalModel.Loads.SelfWeightLoad.LoadCase(selfWeightLoad=createSelfWeightLoad)
code_block_13 = CodeBlock { "Dead"; }
code_block_14 = CodeBlock { "FZ1"; }
byNature_2 = DynamoSimulation.RSA.AnalyticalModel.Loads.LoadCase.ByNature(caseNature=code_block_13, caseName=code_block_14)
lastItem = List.LastItem(list=starting_points_truss.p1)
byPoint_2 = DynamoSimulation.RSA.AnalyticalModel.AnalyticalNode.ByPoint(point=lastItem)
code_block_15 = CodeBlock()
# ---------- code_block_15.designscript (2 lines) ----------
//Load in N
444822.16;
# ----------------------------------------
byNodes = DynamoSimulation.RSA.AnalyticalModel.Loads.NodalLoad.ByNodes(analyticalNodes=byPoint_2, loadCase=byNature_2, fz=code_block_15)
list_create_11 = List.Create(item0=loadCase, item1=byNature_2, item2=byNodes)

# group: Analysis in RSA
list_create_12 = List.Create(item0=setMaterialByName, item1=setSupportByName, item2=list_create_11)
flatten_9 = List.Flatten(list=list_create_12)
code_block_16 = CodeBlock { "ManualConfig"; }
directory_path = Directory("C:\Users\ugury\OneDrive\Masaüstü\Dynamo Lecture\Examples")
calculateWithSave = DynamoSimulation.RSA.Analysis.CalculateWithSave(elements=flatten_9, parameters=code_block_16, directoryPath=directory_path)

# group: RESULTS > Extract Stresses
code_block_17 = CodeBlock { "FXSX"; }
id = DynamoSimulation.RSA.AnalyticalModel.Loads.LoadCase.Id(loadCase=byNature_2)
getMaxValuesList = DynamoSimulation.RSA.RSAResults.Bar.BarStresses.GetMaxValuesList(name=code_block_17, analyticalBars=calculateWithSave.analyticalBars, loadCasesIds=id)
sum = Math.Sum(values=getMaxValuesList@L2)
code_block_18 = CodeBlock(S=sum)
# ---------- code_block_18.designscript (2 lines) ----------
//Convert to N/mm²
Math.Round(S/1000000,2);
# ----------------------------------------
flatten_10 = List.Flatten(list=code_block_18)

# group: RESULTS > Extract Deformation
code_block_19 = CodeBlock(lst=count) { lst[0]; }
code_block_20 = CodeBlock(x=code_block_19) { 0..x-1; }
getItemAtIndex_2 = List.GetItemAtIndex(list=byLines, index=code_block_20)
code_block_21 = CodeBlock { 1; }
getValuesAt = DynamoSimulation.RSA.RSAResults.Bar.BarDisplacements.GetValuesAt(analyticalBar=getItemAtIndex_2, loadCaseId=id, position=code_block_21)
code_block_22 = CodeBlock(d=getValuesAt.UZ)
# ---------- code_block_22.designscript (2 lines) ----------
//Convert to mm
Math.Round(d*1000,2);
# ----------------------------------------
abs = Math.Abs(number=code_block_22)

# group: RESULTS > Extract Selfweight
id_2 = DynamoSimulation.RSA.AnalyticalModel.Loads.LoadCase.Id(loadCase=loadCase)
getValues = DynamoSimulation.RSA.RSAResults.Node.NodeReactions.GetValues(analyticalNode=calculateWithSave.analyticalNodes, loadCaseId=id_2)
sum_2 = Math.Sum(values=getValues.FZ)
code_block_23 = CodeBlock(w=sum_2) { Math.Round(w/9.81); }

# group: Evaluate Stresses
code_block_24 = CodeBlock { TensAllowableStress=172.37; CompAllowableStress=172.37; AllowableDisplacement_mm=50.8; ViolationCoefficient=10; }
stress_score_evaluation = Python(IN[0]=flatten_10, IN[1]=abs, IN[2]=code_block_23, IN[3]=code_block_24.TensAllowableStress, IN[4]=code_block_24.CompAllowableStress, IN[5]=code_block_24.AllowableDisplacement_mm, IN[6]=code_block_24.ViolationCoefficient)  # CPython3
# ---------- stress_score_evaluation.python (59 lines) ----------
import clr
clr.AddReference('ProtoGeometry')
from Autodesk.DesignScript.Geometry import *
#The inputs to this node will be stored as a list in the IN variables.
dataEnteringNode = IN


#Actual stress in the bar
stress=IN[0]

Displacement=IN[1]
#Set the maximal allowable stress
weight=IN[2]
#Sets the scoring system for the stress ratios
TensAllowableStress=IN[3]
bucling=IN[4]
AllowableDisplacement=IN[5]

violation_coef=IN[6]

tensstress=[]
compstress=[]
compindex=[]
for index, value in enumerate(stress):
    if value < 0:
        compstress.append((value))
        compindex.append((index))
    else: 
        tensstress.append((value))    

compstress=[abs(value) for value in compstress]

#CompAllowableStress=[bucling[index] for index in compindex]
CompAllowableStress=bucling

stress_ratio=[]
violation = 0  # Initialize violation as a float or integer

for i in tensstress:
    ratio = i / TensAllowableStress
    stress_ratio.append(ratio)

for i in compstress:
    ratio = i / CompAllowableStress
    stress_ratio.append(ratio)


for d in Displacement:
    ratio = d / AllowableDisplacement
    stress_ratio.append(ratio)

for r in stress_ratio:
    if r - 1 > 0:
        violation += r - 1

weight_score=weight*(1+(violation*violation_coef))

#Assign your output to the OUT variable.
OUT = weight_score
# ----------------------------------------

code_block_25 = CodeBlock(WS=stress_score_evaluation) { WS; }

# group: RSA > Bar End Releases
code_block_26 = CodeBlock { "Pinned-Pinned"; }
setReleaseByName = DynamoSimulation.RSA.AnalyticalModel.AnalyticalBar.SetReleaseByName(analyticalBars=byLines, name=code_block_26)
