# Dynamo custom node 120-Dome-Core.dyf (Dynamo 2.18.1.5096)
# category: BIM4Struc
# packages: Structural Analysis for Dynamo 2.17.0

code_block = CodeBlock { point1 = Point.ByCoordinates(0, 0, 5); point2 = Point.ByCoordinates(0, 0, 3); point3 = Point.ByCoordinates(0, 0, 0); }
list_create = List.Create(item0=code_block.point1, item1=code_block.point2, item2=code_block.point3)

# group: Geometry config
code_block_2 = CodeBlock { 7; }
byCoordinates = Point.ByCoordinates(z=code_block_2)
code_block_3 = CodeBlock { [6.941,12.5,15.89]; }
byCenterPointRadius = Circle.ByCenterPointRadius(centerPoint=list_create, radius=code_block_3)
code_block_4 = CodeBlock { 12; }
regularPolygon = Polygon.RegularPolygon(circle=byCenterPointRadius, numberSides=code_block_4)
explode = Geometry.Explode(geometry=regularPolygon)
pointAtParameter = Curve.PointAtParameter(curve=explode)

# group: Group 1
code_block_5 = CodeBlock(lst=pointAtParameter) { lst[0]; }
byStartPointEndPoint = Line.ByStartPointEndPoint(startPoint=byCoordinates, endPoint=code_block_5)

# group: Group 2
code_block_6 = CodeBlock(lst=explode) { lst[0]; }

# group: Group 3
code_block_7 = CodeBlock(lst=pointAtParameter) { lst[0]; lst[1]; }
byStartPointEndPoint_2 = Line.ByStartPointEndPoint(startPoint=code_block_7.out0, endPoint=code_block_7.out1)

# group: Group 4
code_block_8 = CodeBlock(lst=pointAtParameter) { lst[0]; }
firstItem = List.FirstItem(list=code_block_8)
list_create_2 = List.Create()  # unwired: item0, item1
code_block_9 = CodeBlock(lst=explode) { lst[1]; }
code_block_10 = CodeBlock { 0.5; }
pointAtParameter_2 = Curve.PointAtParameter(curve=code_block_9, param=code_block_10)
combine = List.Combine(combineFunction=list_create_2, list0=code_block_8, list1=pointAtParameter_2)
addItemToEnd = List.AddItemToEnd(item=firstItem, list=combine)
flatten = List.Flatten(list=addItemToEnd)
byPoints = PolyCurve.ByPoints(points=flatten)
explode_2 = Geometry.Explode(geometry=byPoints)

# group: Group 7
code_block_11 = CodeBlock { 0.5; }
code_block_12 = CodeBlock(lst=pointAtParameter) { lst[2]; }
firstItem_2 = List.FirstItem(list=code_block_12)
list_create_3 = List.Create()  # unwired: item0, item1
pointAtParameter_3 = Curve.PointAtParameter(curve=code_block_9, param=code_block_11)
combine_2 = List.Combine(combineFunction=list_create_3, list0=code_block_12, list1=pointAtParameter_3)
addItemToEnd_2 = List.AddItemToEnd(item=firstItem_2, list=combine_2)
flatten_2 = List.Flatten(list=addItemToEnd_2)
byPoints_2 = PolyCurve.ByPoints(points=flatten_2)
explode_3 = Geometry.Explode(geometry=byPoints_2)

# group: Group 5
code_block_13 = CodeBlock(lst=pointAtParameter) { lst[1]; }
firstItem_3 = List.FirstItem(list=code_block_13)
list_create_4 = List.Create()  # unwired: item0, item1
pointAtParameter_4 = Curve.PointAtParameter(curve=code_block_9, param=code_block_11)
combine_3 = List.Combine(combineFunction=list_create_4, list0=code_block_13, list1=pointAtParameter_4)
addItemToEnd_3 = List.AddItemToEnd(item=firstItem_3, list=combine_3)
flatten_3 = List.Flatten(list=addItemToEnd_3)
byPoints_3 = PolyCurve.ByPoints(points=flatten_3)
explode_4 = Geometry.Explode(geometry=byPoints_3)
list_create_5 = List.Create(item0=code_block_13, item1=pointAtParameter_4)

# group: Group 6
code_block_14 = CodeBlock(lst=pointAtParameter) { lst[1]; lst[2]; }
byStartPointEndPoint_3 = Line.ByStartPointEndPoint(startPoint=code_block_14.out0, endPoint=code_block_14.out1)

list_create_6 = List.Create(item0=byStartPointEndPoint, item1=code_block_6, item2=byStartPointEndPoint_2, item3=explode_2, item4=explode_4, item5=byStartPointEndPoint_3, item6=explode_3)
flatten_4 = List.Flatten(list=list_create_6)
sc_index = Input(sc_index: var[]..[])

# group: Sections
code_block_15 = CodeBlock()
# ---------- code_block_15.designscript (27 lines) ----------
["CHS 33.7x3.0",
"CHS 42.4x3.0",
"CHS 48.3x3.0",
"CHS 60.3x3.0",
"CHS 76.1x3.0",
"CHS 60.3x4.0",
"CHS 88.9x3.0",
"CHS 76.1x4.0",
"CHS 114.3x3.0",
"CHS 88.9x4.0",
"CHS 88.9x5.0",
"CHS 114.3x4.0",
"CHS 88.9x6.3",
"CHS 114.3x5.0",
"CHS 114.3x6.0",
"CHS 139.7x5.0",
"CHS 139.7x6.0",
"CHS 139.7x6.3",
"CHS 193.7x5.0",
"CHS 168.3x6.0",
"CHS 219.1x5.0",
"CHS 193.7x6.3",
"CHS 219.1x6.3",
"CHS 244.5x6.3",
"CHS 219.1x8.0",
"CHS 219.1x10.0",
"CHS 406.4x6.3"];
# ----------------------------------------
loadSections = DynamoSimulation.RSA.AnalyticalModel.Attributes.Bars.LoadSections(sectionsToLoad=code_block_15)
code_block_16 = CodeBlock(lst=sc_index) { lst[0]; lst[1]; lst[2]; lst[3]; lst[4]; lst[5]; lst[6]; }
code_block_17 = CodeBlock(t2=code_block_16.out0, t4=code_block_16.out1, t6=code_block_16.out2, t8=code_block_16.out3, t10=code_block_16.out4, t12=code_block_16.out5, t14=code_block_16.out6)
# ---------- code_block_17.designscript (8 lines) ----------
t1 = List.OfRepeatedItem(t2, 12);
t3 = List.OfRepeatedItem(t4, 12);
t5 = List.OfRepeatedItem(t6, 12);
t7 = List.OfRepeatedItem(t8, 24);
t9 = List.OfRepeatedItem(t10, 24);
t11 = List.OfRepeatedItem(t12, 12);
t13 = List.OfRepeatedItem(t14, 24);
t15 = [t1, t3, t5, t7, t9, t11, t13];
# ----------------------------------------
flatten_5 = List.Flatten(list=code_block_17.t15)
getItemAtIndex = List.GetItemAtIndex(list=loadSections, index=flatten_5)

# group: Bars and Section assignment
byLines = DynamoSimulation.RSA.AnalyticalModel.AnalyticalBar.ByLines(lines=flatten_4)
setSectionByName = DynamoSimulation.RSA.AnalyticalModel.AnalyticalBar.SetSectionByName(analyticalBars=byLines@L1, name=getItemAtIndex@L1)
code_block_18 = CodeBlock { "STEEL A36"; }
setMaterialByName = DynamoSimulation.RSA.AnalyticalModel.AnalyticalBar.SetMaterialByName(analyticalBars=setSectionByName, name=code_block_18)
flatten_6 = List.Flatten(list=setMaterialByName)

# group: Bar End Releases
code_block_19 = CodeBlock { "Pinned-Pinned"; }
setReleaseByName = DynamoSimulation.RSA.AnalyticalModel.AnalyticalBar.SetReleaseByName(analyticalBars=setMaterialByName, name=code_block_19)

# group: Slenderness
startPoint = Curve.StartPoint(curve=flatten_4)
endPoint = Curve.EndPoint(curve=flatten_4)
distanceTo = Geometry.DistanceTo(geometry=startPoint, other=endPoint)
radius_of_gyration = CodeBlock()
# ---------- radius_of_gyration.designscript (27 lines) ----------
[10.9,
14,
16.1,
20.3,
25.9,
20,
30.4,
25.5,
39.4,
30,
29.7,
39,
29.3,
38.7,
38.3,
47.7,
47.3,
47.2,
66.7,
57.4,
75.7,
66.3,
75.3,
84.2,
74.7,
74,
141];
# ----------------------------------------
flatten_7 = List.Flatten(list=code_block_17.t15)
getItemAtIndex_2 = List.GetItemAtIndex(list=radius_of_gyration, index=flatten_7)
code_block_20 = CodeBlock(x=distanceTo) { x*1000; }

sum = Math.Sum(values=distanceTo)

# group: Supports
byPoint = DynamoSimulation.RSA.AnalyticalModel.AnalyticalNode.ByPoint(point=code_block_14.out1)
code_block_21 = CodeBlock { "Pinned"; }
setSupportByName = DynamoSimulation.RSA.AnalyticalModel.AnalyticalNode.SetSupportByName(nodes=byPoint, name=code_block_21)

# group: Loads
code_block_22 = CodeBlock { "Dead"; }
code_block_23 = CodeBlock { "Selfweight"; }
byNature = DynamoSimulation.RSA.AnalyticalModel.Loads.LoadCase.ByNature(caseNature=code_block_22, caseName=code_block_23)
createSelfWeightLoad = DynamoSimulation.RSA.AnalyticalModel.Loads.SelfWeightLoad.CreateSelfWeightLoad(loadCase=byNature)
loadCase = DynamoSimulation.RSA.AnalyticalModel.Loads.SelfWeightLoad.LoadCase(selfWeightLoad=createSelfWeightLoad)
byPoint_2 = DynamoSimulation.RSA.AnalyticalModel.AnalyticalNode.ByPoint(point=byCoordinates)
code_block_24 = CodeBlock { "Dead"; }
code_block_25 = CodeBlock { "FZ1"; }
byNature_2 = DynamoSimulation.RSA.AnalyticalModel.Loads.LoadCase.ByNature(caseNature=code_block_24, caseName=code_block_25)
code_block_26 = CodeBlock()
# ---------- code_block_26.designscript (2 lines) ----------
//Load in N
-60000;
# ----------------------------------------
byNodes = DynamoSimulation.RSA.AnalyticalModel.Loads.NodalLoad.ByNodes(analyticalNodes=byPoint_2, loadCase=byNature_2, fz=code_block_26)
code_block_27 = CodeBlock(lst=pointAtParameter) { lst[0]; lst[1]; }
byPoint_3 = DynamoSimulation.RSA.AnalyticalModel.AnalyticalNode.ByPoint(point=code_block_27.out0)
code_block_28 = CodeBlock()
# ---------- code_block_28.designscript (2 lines) ----------
//Load in N
-30000;
# ----------------------------------------
byNodes_2 = DynamoSimulation.RSA.AnalyticalModel.Loads.NodalLoad.ByNodes(analyticalNodes=byPoint_3, loadCase=byNature_2, fz=code_block_28)
byPoint_4 = DynamoSimulation.RSA.AnalyticalModel.AnalyticalNode.ByPoint(point=code_block_27.out1)
code_block_29 = CodeBlock()
# ---------- code_block_29.designscript (2 lines) ----------
//Load in N
-10000;
# ----------------------------------------
byNodes_3 = DynamoSimulation.RSA.AnalyticalModel.Loads.NodalLoad.ByNodes(analyticalNodes=byPoint_4, loadCase=byNature_2, fz=code_block_29)
list_create_7 = List.Create(item0=loadCase, item1=byNodes, item2=byNodes_2, item3=byNodes_3, item4=byNature_2)

# group: Analysis in RSA
list_create_8 = List.Create(item0=flatten_6, item1=setSupportByName, item2=list_create_7)
code_block_30 = CodeBlock { "ManualConfig"; }
directory_path = Directory("C:\Users\ugury\OneDrive\Masaüstü\Thesis_V1\Examples")
calculateWithSave = DynamoSimulation.RSA.Analysis.CalculateWithSave(elements=list_create_8, parameters=code_block_30, directoryPath=directory_path)

# group: Extract Deformation
code_block_31 = CodeBlock(lst=calculateWithSave.loadCases) { lst[1]; }
id = DynamoSimulation.RSA.AnalyticalModel.Loads.LoadCase.Id(loadCase=code_block_31)
code_block_32 = CodeBlock { 0; }
getValuesAt = DynamoSimulation.RSA.RSAResults.Bar.BarDisplacements.GetValuesAt(analyticalBar=calculateWithSave.analyticalBars, loadCaseId=id, position=code_block_32)
code_block_33 = CodeBlock(d=getValuesAt.UZ)
# ---------- code_block_33.designscript (2 lines) ----------
//Convert to mm
Math.Round(d*1000,2);
# ----------------------------------------
abs = Math.Abs(number=code_block_33)
code_block_34 = CodeBlock(lst=abs) { lst[0]; lst[24..35]; lst[60..83]; lst[84..95]; }
code_block_35 = CodeBlock { 0..22..2; }
getItemAtIndex_3 = List.GetItemAtIndex(list=code_block_34.out2, index=code_block_35)
code_block_36 = CodeBlock { 1..23..2; }
getItemAtIndex_4 = List.GetItemAtIndex(list=code_block_34.out2, index=code_block_36)
list_create_9 = List.Create(item0=code_block_34.out0, item1=code_block_34.out1, item2=getItemAtIndex_3, item3=getItemAtIndex_4)
flatten_8 = List.Flatten(list=list_create_9)

# group: Extract Stresses
code_block_37 = CodeBlock { "FXSX"; }
getMaxValuesList = DynamoSimulation.RSA.RSAResults.Bar.BarStresses.GetMaxValuesList(name=code_block_37, analyticalBars=calculateWithSave.analyticalBars, loadCasesIds=id)

sum_2 = Math.Sum(values=getMaxValuesList@L2)

# group (continued): Extract Stresses
flatten_9 = List.Flatten(list=sum_2)
code_block_38 = CodeBlock(S=flatten_9)
# ---------- code_block_38.designscript (2 lines) ----------
//Convert to N/mm²
Math.Round(S/1000000,2);
# ----------------------------------------
flatten_10 = List.Flatten(list=code_block_38)

# group: Extract Selfweight
id_2 = DynamoSimulation.RSA.AnalyticalModel.Loads.LoadCase.Id(loadCase=loadCase)
getValues = DynamoSimulation.RSA.RSAResults.Node.NodeReactions.GetValues(analyticalNode=calculateWithSave.analyticalNodes, loadCaseId=id_2)
sum_3 = Math.Sum(values=getValues.FZ)
code_block_39 = CodeBlock(w=sum_3) { Math.Round(w/9.81); }

# group: Evaluate Stresses
code_block_40 = CodeBlock { TensAllowableStress=172.37; AllowableDisplacement_mm=10; ViolationCoefficient=10; }
bucling_stress = Python(IN[0]=getItemAtIndex_2, IN[1]=code_block_20)  # CPython3
# ---------- bucling_stress.python (41 lines) ----------
# Load the Python Standard and DesignScript Libraries
import sys
import clr
import math
clr.AddReference('ProtoGeometry')
from Autodesk.DesignScript.Geometry import *

# The inputs to this node will be stored as a list in the IN variables.
dataEnteringNode = IN

# Place your code below this line


# Given data
radius_of_gyration = IN[0]  # mm
L = IN[1]  # mm
E = 210000  # n/mm2
Yield_stress = 240  # n/mm2

slenderness = []
final_stresses = []
Cc = math.sqrt(2 * math.pi ** 2 * E / Yield_stress)


for i in range(len(L)):
    slenderness_ratio = L[i] / radius_of_gyration[i]  # Calculate slenderness ratio
    slenderness.append(slenderness_ratio)

for i, ratio in enumerate(slenderness):   
    if ratio > Cc:
        Pcr = math.pi ** 2 * E / ratio ** 2
        final_stresses.append(Pcr)

    else:
        Pc = Yield_stress * (1 - 0.5 * ratio ** 2 / Cc ** 2)
        final_stresses.append(Pc)



# Assign your output to the OUT variable.
OUT = final_stresses
# ----------------------------------------
stress_score_evaluation = Python(IN[0]=flatten_10, IN[1]=flatten_8, IN[2]=code_block_39, IN[3]=code_block_40.TensAllowableStress, IN[4]=bucling_stress, IN[5]=code_block_40.AllowableDisplacement_mm, IN[6]=code_block_40.ViolationCoefficient)  # CPython3
# ---------- stress_score_evaluation.python (60 lines) ----------
import clr
clr.AddReference('ProtoGeometry')
from Autodesk.DesignScript.Geometry import *
#The inputs to this node will be stored as a list in the IN variables.
dataEnteringNode = IN


#Actual stress in the bar
stress=IN[0]

Displacement=IN[1]
#Set the maximal allowable stress
weight=IN[2]
#Sets the scoring system for the stress ratios
TensAllowableStress=IN[3]
bucling=IN[4]
AllowableDisplacement=IN[5]

violation_coef=IN[6]

tensstress=[]
compstress=[]
compindex=[]
for index, value in enumerate(stress):
    if value < 0:
        compstress.append((value))
        compindex.append((index))
    else: 
        tensstress.append((value))    

compstress=[abs(value) for value in compstress]

CompAllowableStress=[bucling[index] for index in compindex]


stress_ratio=[]
violation = 0  # Initialize violation as a float or integer

for i in tensstress:
    ratio = i / TensAllowableStress
    stress_ratio.append(ratio)


for item1, item2 in zip(compstress, CompAllowableStress):
    ratio = item1 / item2
    stress_ratio.append(ratio)


for d in Displacement:
    ratio = d / AllowableDisplacement
    stress_ratio.append(ratio)

for r in stress_ratio:
    if r - 1 > 0:
        violation += r - 1

weight_score=weight*(1+(violation*violation_coef))

#Assign your output to the OUT variable.
OUT = weight_score
# ----------------------------------------

WS = Output(stress_score_evaluation)
