# Dynamo graph GA_2DTRUSS_Literature.dyn (Dynamo 2.17.0.3472)

# note: Geometry config

# group: INITIAL POPULATION CREATOR
lower_limits = CodeBlock { [0,0,0,0,0,0,0]; }
upper_limits = CodeBlock { [27,27,27,27,27,27,27]; }
population_size = CodeBlock { 2; }
python_script = Python(IN[0]=lower_limits, IN[1]=upper_limits, IN[2]=population_size)  # CPython3
# ---------- python_script.python (50 lines) ----------
# Load the Python Standard and DesignScript Libraries
import sys
import clr
import random
import sys
from io import StringIO
sys.stdout = StringIO()
clr.AddReference('ProtoGeometry')
from Autodesk.DesignScript.Geometry import *

# The inputs to this node will be stored as a list in the IN variables.
dataEnteringNode = IN

#population =[[group] for group in population1]
# SECTİON1
lower_limits = IN[0]
upper_limits = IN[1]
population_size = 1
chromosome_length = IN[2]

# Define the limits for each group
group_limits = [(int(lower_limits[i]), upper_limits[i]) if lower_limits[i] == 0 else (lower_limits[i], upper_limits[i]) for i in range(len(lower_limits))]

# Generate the groups of individuals
groups = []
for group_limit in group_limits:
    group = []
    for i in range(population_size):
        if group_limit[0] == 0:
            chromosome = [random.uniform(group_limit[0], group_limit[1]) for j in range(chromosome_length)]
        else:
            chromosome = [random.uniform(group_limit[0], group_limit[1]) for j in range(chromosome_length)]
        group.append(chromosome)
    groups.append(group)

group.append([0])


 

#print("***Starting print***")
#print(fitness)
#print('pop',population)
#print("***Ending print***")
#sys.stdout.seek(0)

#OUT = sys.stdout.read()
OUT =groups
    
 
# ----------------------------------------
flatten = List.Flatten(list=python_script@L2)

# group: INITIAL POPULATION FITTNESS CALCULATOR
iterationNumber = CodeBlock { 0; }
list_create = List.Create(item0=iterationNumber, item1=flatten)
loopcheck = Custom[Loopcheck](IterationNumber=population_size)  # unwired: init
loopBodyVar1Literature = Custom[LoopBodyVar1Literature]()  # unwired: init
loopWhile = LoopWhile(initialValue=list_create, continueWhile=loopcheck, loopBody=loopBodyVar1Literature)

# group: NEXT GENERATION CREATOR
code_block = CodeBlock { 0; }
list_create_2 = List.Create(item0=code_block, item1=loopWhile, item2=loopWhile)
code_block_2 = CodeBlock { 2; }
loopCheck = Custom[LoopCheck](IterationNumber=code_block_2)  # unwired: init
GA_2DTRUSS_Literature = Custom[GA_2DTRUSS_Literature]()  # unwired: init
loopWhile_2 = LoopWhile(initialValue=list_create_2, continueWhile=loopCheck, loopBody=GA_2DTRUSS_Literature)

# group: REVIT CREATOR
code_block_3 = CodeBlock { "CHS-Circular Hollow Sections(Cold)"; }
revitCreator = Custom[RevitCreator](original_list=loopWhile_2, FamilyName=code_block_3)
