# Dynamo custom node LoopBodyVar2Literature.dyf "LoopBodyVar1Literature" (Dynamo 2.18.1.5096)
# category: Thesis.2D.Nvariable.LoopBodyVar2

init = Input(init: var[]..[])
code_block = CodeBlock(lst=init) { lst[0]; }
code_block_2 = CodeBlock(a=code_block) { a+1; }
lower_limits = CodeBlock { [0,0,0,0,0,0,0]; }
upper_limits = CodeBlock { [27,27,27,27,27,27,27]; }
population_size = CodeBlock { 2; }
GENERATİON = Python(IN[0]=init, IN[1]=lower_limits, IN[2]=upper_limits, IN[3]=population_size)  # CPython3
# ---------- GENERATİON.python (317 lines) ----------
# Load the Python Standard and DesignScript Libraries
import sys
import clr
import random
import sys
from io import StringIO
sys.stdout = StringIO()
clr.AddReference('ProtoGeometry')
from Autodesk.DesignScript.Geometry import *

# The inputs to this node will be stored as a list in the IN variables.
dataEnteringNode = IN

lower_limits = IN[1]
upper_limits = IN[2]

population_size = 1
chromosome_length = IN[3]

original_list= IN[0]

inner_list = original_list[1][1]
fitness = inner_list[-1][1:]  # Exclude the first element
variables= inner_list[:-1]
population=[[lst] for lst in variables]


#population =[[group] for group in population1]
#print("population",population)
elite_rate = 3
mutation_rate =0.1



population =[[[round(num, 1) for num in inner_lst] for inner_lst in outer_lst] for outer_lst in population]
#print("population",population)


elite_count = int(population_size * elite_rate)


elite_indices1 = sorted(enumerate(fitness), key=lambda x: x[1])[:elite_count]
#print(elite_indices1)

elite_indices=[tup[0] for tup in elite_indices1]
#print(elite_indices)

elites = [[group[0][index] for index in elite_indices] for group in population]
#print("elites",elites)


# Define the number of individuals in each population
POPULATION_SIZE = 5

# # Define the range of possible values for each element in the list
# MIN_VALUE = [0, 0, 0, 0, 1]
# MAX_VALUE = [4, 4, 4, 4, 20]


def decimal_to_binary(number):
    binary = ''
    binary1 = ''
    if number < 0:
        binary += '-'
        number = abs(number)
    
    integer_part = int(number)

    if not float(number).is_integer():
        decimal_part1 = str(number)
        decimal_part = int(decimal_part1.split('.')[1])
    else:
        decimal_part=0

    ##print("integer_part",integer_part,"decimal_part",decimal_part)
    # Convert integer part to binary
    if integer_part == 0:
        binary += '0'
    else:
        while integer_part > 0:
            binary = str(integer_part % 2) + binary
            integer_part = integer_part // 2
    
    # Add decimal point if necessary
    if decimal_part == 0:
        binary1 += '0'
    else:
        while decimal_part > 0:
            binary1 =   str(decimal_part % 2) + binary1
            decimal_part = decimal_part // 2

    binary=binary+'.'+binary1
    return binary

a=decimal_to_binary(2.0)
##print("aaaaaaaaaaaaa",a)
def binary_to_decimal(binary):

    # Check if the number is negative
    negative = False
    if binary[0] == '-':
        negative = True
        binary = binary[1:]
    
    # Split the binary string into integer and decimal parts
    int_part, frac_part = binary.split('.')
    ##print("int_part",int_part,"frac_part",frac_part)
    
    # Convert the integer part to decimal
    integer_part = 0

    for i, digit in enumerate(int_part[::-1]):
        if digit == '1':
            integer_part += 2**i
    
    # Convert the decimal part to decimal
    decimal_part = 0

    
    for i, digit in enumerate(frac_part[::-1]):
        if digit == '1':
            decimal_part += 2**i
    
    ##print("integer_partturn",integer_part,"decimal_partturn",decimal_part)
    # Combine the integer and decimal parts
    number = float(str(integer_part)+ '.'+ str(decimal_part))
    ##print(number)
    # Apply the negative sign if necessary
    if negative:
        number *= -1
    
    return round(number,1)

def find_differing_positions(num1, num2):
    differing_positions = []
    # Convert the binary numbers to strings
    num1_str = str(num1)
    num2_str = str(num2)
    
    # Find the length of the longer number
    max_length = max(len(num1_str), len(num2_str))
    
    # Pad the numbers with leading zeros to make them equal in length
    num1_str = num1_str.zfill(max_length)
    num2_str = num2_str.zfill(max_length)
    
    # Compare the numbers bit by bit
    for i in range(max_length):
        if num1_str[i] != num2_str[i]:
            differing_positions.append(i)
    
    return differing_positions

def binary_crossover(individual1, individual2):
    # Convert to lists if arguments are not already lists
    if type(individual1) is not list:
        individual1 = [individual1]
    if type(individual2) is not list:
        individual2 = [individual2]
        
    
    offspring1 = []
    offspring2 = []
    ##print("individual1",individual1)
    ##print("individual2",individual2)
    for i in range(min(len(individual1), len(individual2))):
        gene1 = decimal_to_binary(individual1[i])
        gene2 = decimal_to_binary(individual2[i])
        ##print("gene1",gene1)
        ##print("gene2",gene2)
        
        # Split the binary string into integer and fractional parts
        int_part1, frac_part1 = gene1.split('.')
        int_part2, frac_part2 = gene2.split('.')
        
        # Determine the maximum length of the integer and fractional parts
        max_int_len = max(len(int_part1), len(int_part2))
        max_frac_len = max(len(frac_part1), len(frac_part2))
        
        # Pad the integer and fractional parts with zeros to make them equal length
        int_part1 = int_part1.zfill(max_int_len)
        int_part2 = int_part2.zfill(max_int_len)
        frac_part1 = frac_part1.ljust(max_frac_len, '0')
        frac_part2 = frac_part2.ljust(max_frac_len, '0')
        """#print("int_part1",int_part1,
        "int_part2" ,int_part2,
        "frac_part1", frac_part1,
        "frac_part2", frac_part2)"""
        

        diff_index_int= find_differing_positions(int_part1, int_part2)
        diff_index1_frac= find_differing_positions(frac_part1, frac_part2)
        ##print("diff_index_int",diff_index_int,"diff_index1_frac",diff_index1_frac)
        if not diff_index1_frac:
            diff_index1_frac = [0]

        if not diff_index_int:
            diff_index_int = [0]


        # Perform crossover on the integer part
        crossover_index = random.choice(diff_index_int)
        ##print("crossover_indexint",crossover_index)
        int_part1_new = list(int_part1)
        int_part2_new = list(int_part2)
        int_part1_new[crossover_index] = int_part2[crossover_index]
        int_part2_new[crossover_index] = int_part1[crossover_index]
        int_part1_new = ''.join(int_part1_new)
        int_part2_new = ''.join(int_part2_new)
        
        # Perform crossover on the fractional part
        
        crossover_index = random.choice(diff_index1_frac)
        ##print("crossover_indexfrac",crossover_index)
        frac_part1_new = list(frac_part1)
        frac_part2_new = list(frac_part2)
        frac_part1_new[crossover_index] = frac_part2[crossover_index]
        frac_part2_new[crossover_index] = frac_part1[crossover_index]
        frac_part1_new = ''.join(frac_part1_new)
        frac_part2_new = ''.join(frac_part2_new)
        
        # Combine the integer and fractional parts of the offspring
        gene1_new = int_part1_new + '.' + frac_part1_new
        gene2_new = int_part2_new + '.' + frac_part2_new
        ##print("gene1_new",gene1_new)
        ##print("gene2_new",gene2_new)
        
        # Convert the binary string back to float gene
        gene1_new = binary_to_decimal(gene1_new)
        gene2_new = binary_to_decimal(gene2_new)

        
        offspring1.append(gene1_new)
        offspring2.append(gene2_new)
    
    return offspring1, offspring2




offspring = []
for i, elite in enumerate(elites):
    #print(f"New populations for elite {i+1}: {elite}")
    population = []
    for k in range(POPULATION_SIZE):
        # Choose different parents from the elite
        parents = random.sample(elite, 2)
        parent1, parent2 = parents[0], parents[1]

        offspring1 = binary_crossover(parent1,parent2)
        #print(offspring1)
        #offspring1 = mutation(offspring1)
        # offspring2 = mutation(offspring2)
        population.append(offspring1)
    population = [element for sublist in population for element in sublist]
    #print(f"Population {i+1}: {population}")




    unique_population = []
    for sublist in population:
        if sublist not in unique_population:
            unique_population.append(sublist)
    #print("unique_population",unique_population) 
    
    
    unique_population=[item for item in unique_population if lower_limits[i] <= item[0] < upper_limits[i]]
   
    # Count the number of elements in the elites list
    count = len(elites[0])
    #print("count",count,elites[0])
    # Find the average of the elements in the elites list
    average = sum(elites[0]) / count
    #print("average",average,sum(elites[0]))


    # If there are still elements in the elites list
    if len(unique_population) > chromosome_length:
        while len(unique_population) > chromosome_length:
        # Find the element in the elites list that is farthest from the average
            farthest_element = max(unique_population, key=lambda x: abs(x[0] - average))
            #print("uzun",len(unique_population))

        # Remove the farthest element from the elites list
            unique_population.remove(farthest_element)
    elif len(unique_population) < chromosome_length:
        while len(unique_population) < chromosome_length:
            unique_population.append([random.uniform(lower_limits[i], upper_limits[i])])
    # Return the filtered and processed elites list
    elif [0] in unique_population:
        index = unique_population.index([0])
        unique_population[index] = [random.uniform(lower_limits[i], upper_limits[i])]

    population4=unique_population


    #print(f"mutation {1}: {population4}")

    offspring.append(unique_population)  
    #print("offspring",offspring) 

flattened_list = [[inner[0] for inner in outer] for outer in offspring]

flattened_list.append([0])
 

#print("***Starting print***")
#print(fitness)
#print('pop',population)
#print("***Ending print***")
#sys.stdout.seek(0)

#OUT = sys.stdout.read()
OUT =flattened_list
    
 
# ----------------------------------------
code_block_3 = CodeBlock(lst=GENERATİON) { lst[0]; }
count = List.Count(list=code_block_3)

# group: INITIAL POPULATION FITTNESS CALCULATOR
code_block_4 = CodeBlock { 0; }
list_create = List.Create(item0=code_block_4, item1=GENERATİON)
loopCheck = Custom[LoopCheck](IterationNumber=count)  # unwired: init
loopBodyVar1Literature = Custom[LoopBodyVar1Literature]()  # unwired: init
loopWhile = LoopWhile(initialValue=list_create, continueWhile=loopCheck, loopBody=loopBodyVar1Literature)

python_script = Python(IN[0]=loopWhile, IN[1]=init)  # CPython3
# ---------- python_script.python (95 lines) ----------
# Load the Python Standard and DesignScript Libraries
import sys
import clr
import random
import sys
from io import StringIO
sys.stdout = StringIO()
clr.AddReference('ProtoGeometry')
from Autodesk.DesignScript.Geometry import *

# The inputs to this node will be stored as a list in the IN variables.
dataEnteringNode = IN


population_size = 1
chromosome_length = 8

original_list= IN[0]
original_list2= IN[1]

inner_list1 = original_list2[1][1]
last_list1 = inner_list1[-1][1:]  # Exclude the first element
variables1 = inner_list1[:-1]
variables1 = [[lst] for lst in variables1]

# # print(last_list1)
# # print(variables1)

inner_list = original_list[1]
fitness1 = inner_list[-1][1:]  # Exclude the first element
variables= inner_list[:-1]
population1=[[lst] for lst in variables]

population = []
for sublist1, sublist2 in zip(population1, variables1):
    combined_sublist = sublist1[0] + sublist2[0]
    population.append([combined_sublist])


fitness= fitness1+last_list1
# print("fitness",fitness,"population",population)


elite_rate = 3
mutation_rate =0.1
population_size = 1
chromosome_length = 8




population =[[[round(num, 1) for num in inner_lst] for inner_lst in outer_lst] for outer_lst in population]
# # print("population",population)


elite_count = 8


elite_indices1 = sorted(enumerate(fitness), key=lambda x: x[1])[:elite_count]
# print(elite_indices1)

elite_indices=[tup[0] for tup in elite_indices1]
# print(elite_indices)

elites = [[group[0][index] for index in elite_indices] for group in population]
# print("elites",elites)



elites_fittness = [fitness[index] for index in elite_indices] 
elites_fittness=[0]+elites_fittness
# print("elites_fittness",elites_fittness)

output=[0]+[elites+[elites_fittness]]

inner_list2 = original_list2[2][1]
last_list2 = inner_list2[-1][1:]  # Exclude the first element
variables2 = inner_list2[:-1]
variables2 = [[lst] for lst in variables2]

hsfitness=[0]+last_list2+fitness1

hspop=[]

for sublist1, sublist2 in zip(variables2, population1):
    combined_sublist = sublist1[0] + sublist2[0]
    hspop.append([combined_sublist])

hspop = [item for sublist in hspop for item in sublist]
output2=["history"]+[hspop+[hsfitness]]
result=output+output2
# print("output",output)
OUT =output,output2
    
 
# ----------------------------------------
code_block_5 = CodeBlock(lst=python_script) { lst[0]; lst[1]; }
list_create_2 = List.Create(item0=code_block_2, item1=code_block_5.out0, item2=code_block_5.out1)
results = Output(list_create_2)
