# Dynamo custom node RevitCreator.dyf (Dynamo 2.18.1.5096)
# category: BIM4Struc

code_block = CodeBlock { "CHS-Circular Hollow Sections(Cold)"; }
code_block_2 = CodeBlock { point1 = Point.ByCoordinates(0, 0, 5); point2 = Point.ByCoordinates(0, 0, 3); point3 = Point.ByCoordinates(0, 0, 0); }
list_create = List.Create(item0=code_block_2.point1, item1=code_block_2.point2, item2=code_block_2.point3)

# group: Geometry config
code_block_3 = CodeBlock { [6.941,12.5,15.89]; }
byCenterPointRadius = Circle.ByCenterPointRadius(centerPoint=list_create, radius=code_block_3)
code_block_4 = CodeBlock { 12; }
regularPolygon = Polygon.RegularPolygon(circle=byCenterPointRadius, numberSides=code_block_4)
explode = Geometry.Explode(geometry=regularPolygon)
pointAtParameter = Curve.PointAtParameter(curve=explode)
code_block_5 = CodeBlock { 7; }
byCoordinates = Point.ByCoordinates(z=code_block_5)

# group: Group 4
code_block_6 = CodeBlock(lst=explode) { lst[1]; }
code_block_7 = CodeBlock(lst=pointAtParameter) { lst[0]; }
firstItem = List.FirstItem(list=code_block_7)
list_create_2 = List.Create()  # unwired: item0, item1
code_block_8 = CodeBlock { 0.5; }
pointAtParameter_2 = Curve.PointAtParameter(curve=code_block_6, param=code_block_8)
combine = List.Combine(combineFunction=list_create_2, list0=code_block_7, list1=pointAtParameter_2)
addItemToEnd = List.AddItemToEnd(item=firstItem, list=combine)
flatten = List.Flatten(list=addItemToEnd)
byPoints = PolyCurve.ByPoints(points=flatten)
explode_2 = Geometry.Explode(geometry=byPoints)

# group: Group 7
code_block_9 = CodeBlock { 0.5; }
code_block_10 = CodeBlock(lst=pointAtParameter) { lst[2]; }
firstItem_2 = List.FirstItem(list=code_block_10)
list_create_3 = List.Create()  # unwired: item0, item1
pointAtParameter_3 = Curve.PointAtParameter(curve=code_block_6, param=code_block_9)
combine_2 = List.Combine(combineFunction=list_create_3, list0=code_block_10, list1=pointAtParameter_3)
addItemToEnd_2 = List.AddItemToEnd(item=firstItem_2, list=combine_2)
flatten_2 = List.Flatten(list=addItemToEnd_2)
byPoints_2 = PolyCurve.ByPoints(points=flatten_2)
explode_3 = Geometry.Explode(geometry=byPoints_2)

# group: Group 5
code_block_11 = CodeBlock(lst=pointAtParameter) { lst[1]; }
pointAtParameter_4 = Curve.PointAtParameter(curve=code_block_6, param=code_block_9)
list_create_4 = List.Create(item0=code_block_11, item1=pointAtParameter_4)
firstItem_3 = List.FirstItem(list=code_block_11)
list_create_5 = List.Create()  # unwired: item0, item1
combine_3 = List.Combine(combineFunction=list_create_5, list0=code_block_11, list1=pointAtParameter_4)
addItemToEnd_3 = List.AddItemToEnd(item=firstItem_3, list=combine_3)
flatten_3 = List.Flatten(list=addItemToEnd_3)
byPoints_3 = PolyCurve.ByPoints(points=flatten_3)
explode_4 = Geometry.Explode(geometry=byPoints_3)

# group: Group 1
code_block_12 = CodeBlock(lst=pointAtParameter) { lst[0]; }
byStartPointEndPoint = Line.ByStartPointEndPoint(startPoint=byCoordinates, endPoint=code_block_12)

# group: Group 2
code_block_13 = CodeBlock(lst=explode) { lst[0]; }

# group: Group 3
code_block_14 = CodeBlock(lst=pointAtParameter) { lst[0]; lst[1]; }
byStartPointEndPoint_2 = Line.ByStartPointEndPoint(startPoint=code_block_14.out0, endPoint=code_block_14.out1)

# group: Group 6
code_block_15 = CodeBlock(lst=pointAtParameter) { lst[1]; lst[2]; }
byStartPointEndPoint_3 = Line.ByStartPointEndPoint(startPoint=code_block_15.out0, endPoint=code_block_15.out1)

list_create_6 = List.Create(item0=byStartPointEndPoint, item1=code_block_13, item2=byStartPointEndPoint_2, item3=explode_2, item4=explode_4, item5=byStartPointEndPoint_3, item6=explode_3)
flatten_4 = List.Flatten(list=list_create_6)
levels = Levels("L1")
FamilyName = Input(FamilyName: string)
byName = Family.ByName(name=FamilyName)
types = Family.Types(family=byName)
original_list = Input(original_list: var[]..[])
getting_best_design_option = CodeBlock(t2=original_list)
# ---------- getting_best_design_option.designscript (5 lines) ----------
t1 = List.GetItemAtIndex(t2, 1);
t3 = List.GetItemAtIndex(t1, 1);
t4 = List.GetItemAtIndex(t3@L2<1>, 0);
t5 = List.DropItems(t4, -1);
num5 = Math.Floor(t5);
# ----------------------------------------
watch = Watch(getting_best_design_option.num5)
code_block_16 = CodeBlock(lst=watch) { lst[0]; lst[1]; lst[2]; lst[3]; lst[4]; lst[5]; lst[6]; }
code_block_17 = CodeBlock(t2=code_block_16.out0, t4=code_block_16.out1, t6=code_block_16.out2, t8=code_block_16.out3, t10=code_block_16.out4, t12=code_block_16.out5, t14=code_block_16.out6)
# ---------- code_block_17.designscript (8 lines) ----------
t1 = List.OfRepeatedItem(t2, 12);
t3 = List.OfRepeatedItem(t4, 12);
t5 = List.OfRepeatedItem(t6, 12);
t7 = List.OfRepeatedItem(t8, 24);
t9 = List.OfRepeatedItem(t10, 24);
t11 = List.OfRepeatedItem(t12, 12);
t13 = List.OfRepeatedItem(t14, 24);
t15 = [t1, t3, t5, t7, t9, t11, t13];
# ----------------------------------------
flatten_5 = List.Flatten(list=code_block_17.t15)
getItemAtIndex = List.GetItemAtIndex(list=types, index=flatten_5)
beamByCurve = StructuralFraming.BeamByCurve(curve=flatten_4@L1, level=levels, structuralFramingType=getItemAtIndex@L1)
MODEL_SUCCESFULLY_CREATED_ON_REVIT = Output(beamByCurve)  # ""MODEL SUCCESFULLY CREATED ON REVIT""
