# Dynamo custom node LoopBodyVar1Literature.dyf (Dynamo 2.17.0.3472)
# category: Thesis.2D.Nvariable.LoopBodyVar1

init = Input(init: var[]..[])
code_block = CodeBlock(lst=init) { lst[0]; }
watch = Watch(code_block)
code_block_2 = CodeBlock(a=watch) { a+1; }
getItemAtIndex = List.GetItemAtIndex(list=init@L2, index=watch)
code_block_3 = CodeBlock { 1; }
getItemAtIndex_2 = List.GetItemAtIndex(list=init, index=code_block_3)
count = List.Count(list=getItemAtIndex_2)
code_block_4 = CodeBlock(x=count) { x-1; }
removeItemAtIndex = List.RemoveItemAtIndex(list=getItemAtIndex, indices=code_block_4)
floor = Math.Floor(number=removeItemAtIndex)
n10bar_truss_core = Custom[10bar_truss_core](Sections=floor)  # Calculates weight score of 10 bar truss
getItemAtIndex_3 = List.GetItemAtIndex(list=getItemAtIndex_2, index=code_block_4)
addItemToEnd = List.AddItemToEnd(item=n10bar_truss_core, list=getItemAtIndex_3)
code_block_5 = CodeBlock { -1; }
dropItems = List.DropItems(list=getItemAtIndex_2, amount=code_block_5)
addItemToEnd_2 = List.AddItemToEnd(item=addItemToEnd, list=dropItems)
list_create = List.Create(item0=code_block_2, item1=addItemToEnd_2)
list = Output(list_create)
