# Dynamo custom node LoopCheckLiterature.dyf "backup" (Dynamo 2.17.0.3472)
# category: Thesis.2D.Nvariable.LoopCheck

init = Input(init: var[]..[])
firstItem = List.FirstItem(list=init)
IterationNumber = Input(IterationNumber: var[]..[])
lt = firstItem < IterationNumber
Continue = Output(lt)  # "Continue?"
